# Grasshopper definition testTypeHint.ghx (Grasshopper 1.0.7)
# plug-ins: RhinoCodePluginGH

S = Script()  # -> out, nohintOUT; inputs floatIN: Double, boolIN: Boolean, intIN: Int32, strIN: String, guidIN: Guid, colorIN: Color, pointIN: Point3d, vectorIN: Vector3d, planeIN: Plane, boxIN: Box, transformIN: Transform, lineIN: Line, polylineIN: Polyline, rectangleIN: Rectangle3d, curveIN: Curve, meshIN: Mesh, surfaceIN: Surface, brepIN: Brep, geometrybaseIN: GeometryBase; unedited script template
number_slider = Slider(0, range=0..100)
everything = KitchenSinkComponentExample(x=reverse(number_slider), y=simplify(number_slider), z=flatten(number_slider))  # -> graft(result); inputs x: Double, y: Double, z: Double
# ---------- everything: Python ----------
"""
Do something silly in cpy.

This component does nothing useful, it's only a kitchen sink (but in cpy) example showing most available options.

    Args:
        x: X value
        y: Y value
        z: Z value
    Returns:
        result: The sum of all three values.
"""
from ghpythonlib.componentbase import executingcomponent as component
import System
import platform
import Rhino
import Grasshopper
import rhinoscriptsyntax as rs


class MyComponent(component):
    def RunScript(self, x: float, y: float, z: float):
        ghenv.Component.Message = f"Cpy Version: {platform.python_version()}"
        result = x + y + z
        return result
# ---------- end everything ----------
panel = Panel(everything)
