# Grasshopper definition unnamed_fullfile.ghx (Grasshopper 1.0.7)
# plug-ins: RhinoCodePluginGH

S = Script()  # -> out, a
# ---------- S: Python ----------
"""This is a new script instance"""
import System
import Rhino
import Grasshopper

import rhinoscriptsyntax as rs


class MyComponent(Grasshopper.Kernel.GH_ScriptInstance):
    def RunScript(self, compasnew_x, y):
        """Grasshopper Script compas action"""
        a = "Hello Python 3 in Grasshopper!"
        print(a)
        
        return
# ---------- end S ----------
everything = KitchenSinkComponentExample()  # -> graft(result)
# ---------- everything: Python ----------
"""
Do something silly.

This component does nothing useful, it's only a kitchen sink example showing most available options.

    Args:
        x: X value
        y: Y value
        z: Z value
    Returns:
        result: The sum of all three values.
"""
from ghpythonlib.componentbase import executingcomponent as component


class KitchenSinkComponent(component):
    def RunScript(self, x, y, z):
        self.Message = 'COMPONENT v{{version}}'
        return x + y + z
# ---------- end everything ----------
